# Grasshopper definition SolarGAN_Hops_Template.gh (Grasshopper 1.0.7)
# plug-ins: Hops

brep = Brep(<brep referenced from the Rhino model>)
path = FilePath("C:\Users\phili\Documents\GitHub\SolarGAN\beta_vae_idgan\data\graycube\sg_graycube__11.PNG")
pt = Point(<point referenced from the Rhino model>)
image_resource = ImageResource(path)
hops = Hops(
    Path=path,
    CacheResultsInMemory=False,
    CacheSolveResults=False,
    RemoteDefinitionLocation="http://127.0.0.1:5000/att_processing",
    RemoteSolveVersion=(0, 1, 0),
    ShowInput_Enabled=False,
    ShowInput_Path=False,
    SynchronousSolve=True)  # -> C_mu, C_var
panel = Panel(path)
panel_2 = Panel(hops.C_mu)
brep_cp = BrepClosestPoint(Point=pt, Brep=brep)  # -> Point, Normal, Distance
number_slider = Slider(0.235, range=-1..1)
number_slider_2 = Slider(104.04, range=0..180)
number_slider_3 = Slider(23, range=0..90)
pt2num = PointsToNumbers(Points=brep_cp.Normal, Mask=4)
pt2num_2 = PointsToNumbers(Points=brep_cp.Point, Mask=4)
button = Button()
item = ListItem(List=pt2num_2, Index="2", Wrap=True)
item_2 = ListItem(List=pt2num, Index="1", Wrap=True)
item_3 = ListItem(List=pt2num, Index="0", Wrap=True)
num = Number(Slider(1, range=0..1))
hops_2 = Hops(
    Run=Toggle(True),
    EnsembleSize=Slider(100, range=0..100),
    ImageFeatures=panel_2,
    Latitude=num,
    Longitude=num,
    Height=num,
    SurfaceNormalX=num,
    SurfaceNormalY=num,
    MonthlyIndex=Slider(11, range=1..12),
    SolarDeclination=num,
    CacheResultsInMemory=False,
    CacheSolveResults=False,
    RemoteDefinitionLocation="http://127.0.0.1:5000/timeseries_gen",
    RemoteSolveVersion=(0, 1, 0),
    ShowInput_Enabled=False,
    ShowInput_Path=False,
    SynchronousSolve=True)
num_2 = Number(item)
split = SplitList(List=hops_2, Index=Slider(168, range=0..1000))  # -> ListA, ListB
graph = QuickGraph(split.ListA, SortOrder=0)
# 30: Glazing ratio
# 16: near far
# 12: up down
hops_3 = Hops(
    C_mu=panel_2,
    C_dim=Slider(17, range=0..100),
    Value=Slider(0, range=-5..5),
    CacheResultsInMemory=False,
    CacheSolveResults=False,
    RemoteDefinitionLocation="http://127.0.0.1:5000/wwr_traversal",
    RemoteSolveVersion=(0, 1, 0),
    ShowInput_Enabled=False,
    ShowInput_Path=False,
    SynchronousSolve=True)
image_resource_2 = ImageResource(hops_3)
