# Grasshopper definition unnamed.gh (Grasshopper 1.0.7)
# plug-ins: Hops

path = FilePath("C:\Users\Philip\Documents\repos\SolarGAN\beta_vae_idgan\data\graycube\sg_graycube__5.PNG")
hops = Hops(
    Path=path,
    CacheResultsInMemory=False,
    CacheSolveResults=False,
    RemoteDefinitionLocation="http://127.0.0.1:5000/att_processing",
    RemoteSolveVersion=(0, 1, 0),
    ShowInput_Enabled=False,
    ShowInput_Path=False,
    SynchronousSolve=True)  # -> C_mu, C_var
image_resource = ImageResource(path)
panel = Panel(hops.C_mu)
panel_2 = Panel(hops.C_var)
